# Dynamo graph Element.SetParameterByName.dyn (Dynamo 2.17.0.3472)

select_model_elements = DSModelElementsSelection()  # 1 picked in the model
code_block = CodeBlock { "Comments"; }
code_block_2 = CodeBlock { "Test"; }
setParameterByName = Element.SetParameterByName(element=select_model_elements, parameterName=code_block, value=code_block_2)
