# Dynamo graph SteelMTORevit2019.dyn (Dynamo 1.3.4.6666)

# group: Beam Quantities
file_path = Filename("C:\Users\kousiya\Downloads\SteelMTO.xlsx")
code_block = CodeBlock { "Beam"; }
code_block_2 = CodeBlock { 1; }
code_block_3 = CodeBlock { 0; }
categories = Categories("StructuralFraming")
all_elements_of_category = ElementsOfCategory(categories)
name = FamilyType.Name(all_elements_of_category)
boolean = BoolSelector(false)
writeToFile = Excel.WriteToFile(filePath=file_path, sheetName=code_block, startRow=code_block_2, startCol=code_block_3, data=name, overWrite=boolean)
code_block_4 = CodeBlock { 1; }
code_block_5 = CodeBlock { "Length"; }
getParameterValueByName = Element.GetParameterValueByName(element=all_elements_of_category, parameterName=code_block_5)
writeToFile_2 = Excel.WriteToFile(filePath=file_path, sheetName=code_block, startRow=code_block_4, startCol=code_block_4, data=getParameterValueByName, overWrite=boolean)

# group: Column Quantities
file_path_2 = Filename("C:\Users\kousiya\Downloads\SteelMTO.xlsx")
code_block_6 = CodeBlock { "Column"; }
code_block_7 = CodeBlock { 1; }
code_block_8 = CodeBlock { 0; }
categories_2 = Categories("StructuralColumns")
all_elements_of_category_2 = ElementsOfCategory(categories_2)
name_2 = FamilyType.Name(all_elements_of_category_2)
boolean_2 = BoolSelector(false)
writeToFile_3 = Excel.WriteToFile(filePath=file_path_2, sheetName=code_block_6, startRow=code_block_7, startCol=code_block_8, data=name_2, overWrite=boolean_2)
code_block_9 = CodeBlock { 1; }
code_block_10 = CodeBlock { "Length"; }
getParameterValueByName_2 = Element.GetParameterValueByName(element=all_elements_of_category_2, parameterName=code_block_10)
writeToFile_4 = Excel.WriteToFile(filePath=file_path_2, sheetName=code_block_6, startRow=code_block_9, startCol=code_block_9, data=getParameterValueByName_2, overWrite=boolean_2)
