# Dynamo graph SteelMTO.dyn (Dynamo 2.17.0.3472)

# group: Beam MTO
file_path = Filename("C:\Users\bbalaji.INDHT\Desktop\SteelMTO")
code_block = CodeBlock { "Beam"; }
code_block_2 = CodeBlock { 1; }
code_block_3 = CodeBlock { 0; }
categories = Categories("OST_StructuralFraming")
all_elements_of_category = ElementsOfCategory(Category=categories)
name = FamilyType.Name(familyType=all_elements_of_category)
boolean = BoolSelector(false)
exportToExcel = Data.ExportToExcel(filePath=file_path, sheetName=code_block, startRow=code_block_2, startColumn=code_block_3, data=name, overWrite=boolean, writeAsString=boolean)
code_block_4 = CodeBlock { "Length"; }
getParameterValueByName = Element.GetParameterValueByName(element=all_elements_of_category, parameterName=code_block_4)
exportToExcel_2 = Data.ExportToExcel(filePath=file_path, sheetName=code_block, startRow=code_block_2, startColumn=code_block_2, data=getParameterValueByName, overWrite=boolean, writeAsString=boolean)

# group: Column MTO
file_path_2 = Filename("C:\Users\bbalaji.INDHT\Desktop\SteelMTO")
code_block_5 = CodeBlock { "Column"; }
code_block_6 = CodeBlock { 0; 1; }
categories_2 = Categories("OST_StructuralColumns")
all_elements_of_category_2 = ElementsOfCategory(Category=categories_2)
name_2 = FamilyType.Name(familyType=all_elements_of_category_2)
boolean_2 = BoolSelector(false)
type_name = Data.ExportToExcel(filePath=file_path_2, sheetName=code_block_5, startRow=code_block_6.out1, startColumn=code_block_6.out0, data=name_2, overWrite=boolean_2, writeAsString=boolean_2)
code_block_7 = CodeBlock { 1; 0; }
code_block_8 = CodeBlock { "Length"; }
getParameterValueByName_2 = Element.GetParameterValueByName(element=all_elements_of_category_2, parameterName=code_block_8)
boolean_3 = BoolSelector(false)
length = Data.ExportToExcel(filePath=file_path_2, sheetName=code_block_5, startRow=code_block_7.out0, startColumn=code_block_7.out0, data=getParameterValueByName_2, overWrite=boolean_3, writeAsString=boolean_3)
